# Grasshopper definition ICMLTableMaker.gh (Grasshopper 1.0.7)
# plug-ins: Redback, Python

panel = Panel("""{
"css":[
{"filters": [{"eval": "True", "searchType": "eval"} ], "style": {"paragraphStyle":"Table - Small","characterStyle": "Bold"}}
]
}""")
panel_2 = Panel("""AABBC
!243
ABCB
A243
AABBC
!243
ABCB
A243""")
partition = PartitionList(List=panel_2, Size=2)
# Component Info - Copy to Notepad: ICML Generator
# ICML
# Takes JSON data formated as a lists of lists and creates a InCopy Markup Language format of a table.
# Redback
# Table
# 89da792a-24b2-41fa-a674-20d9df2b5b6f
panel_3 = Panel("value")
panel_4 = Panel("C:\Users\Andrew.Butler\Cox Architecture Pty Ltd\DT Group - Computational Design\CoDe Resources - Development\py\pyTableMaker\testing")
json = JSON(Key=panel_3, Value=graft(partition))
unflatten = UnflattenTree(Tree=json, Guide=partition)  # -> simplify(Tree)
treetolist = GhPythonScript(Tree=unflatten)  # -> List; inputs Tree: tree
# ---------- treetolist: Python ----------
"""Converts Grasshopper Tree format to List format.
    Inputs:
        Tree: Tree to convert
    Output:
        List: Restructured data"""

from ghpythonlib.componentbase import executingcomponent as component
import Grasshopper, GhPython
import System
import Rhino
import rhinoscriptsyntax as rs

class MyComponent(component):
    
    def RunScript(self, Tree):
                        
        List = None
        __author__ = "danielle.bisazza"
        __version__ = "2022.06.30"
        import Grasshopper as gh
        import sys
        import json
                        
                        
        def TreeToPythonList(input, retrieve_base = lambda x: x[0]):
            """Returns a list representation of a Grasshopper DataTree"""
            def extend_at(path, index, simple_input, rest_list):
                #print("INPUT -- ", simple_input)
                #print("REST LIST ---", rest_list)
                target = path[index]
                #print("TARGET --", target)
                #print("INDEX  --", index)
                #try:
                    #simple_input = [int("%.2f") %num for num in list(simple_input)] #round ints to 2dec
                #except:
                    #simple_input = list(simple_input)
                sortList = []
                for value in list(simple_input):
                    #print("VALUE:  ", value, "TPYE:  ", type(value))
                    if type(value) == type(""):
                        try: 
                            value = json.loads(str(value))
                        except:
                            pass
                        sortList.append(value)
                        #print(value)
                    #### TO BE FIXED? - FLOATS ####
                    elif type(value) == type(0.0):
                        try:
                            value = "{:.2f}".format(value)
                            #print ("FLOAT", value)
                        except:
                            pass
                        sortList.append(value)
                    else:
                        sortList.append(value)
                                        
                #print(sortList)
                if len(rest_list) <= target: #make empty space for new value
                    #print("-MAKING NEW SPOT-", rest_list)
                    rest_list.extend([None]*(target-len(rest_list)+1))
                elif not (isinstance(i, list) for i in rest_list):
                    #print("EXTENDED LIST -- ", rest_list)
                    pass
                if index == path.Length - 1:
                    try:
                        if rest_list[target] != None: #if trying to replace value
                            #print(">><<<")
                            rest_list.insert(target, sortList)
                        else:
                            #print("replace", rest_list[target], sortList)
                            rest_list[target] = sortList
                            #print("new -- ", rest_list)
                    except:
                        rest_list[target] = sortList
                else:
                    if rest_list[target] is None: 
                        rest_list[target] = []
                    #print ("---- LOOOPPP ----", type(rest_list))
                    extend_at(path, index+1, sortList, rest_list[target])
            #print(input)
            all = []
            for i in range(input.BranchCount):
                #print(i)
                path = input.Path(i)
                print(path)
                extend_at(path, 0, input.Branch(path), all)
            if retrieve_base(all) < len(all):
                all = retrieve_base(all)
                #print(all)
            #print(retrieve_base(all))
            all = (all)
                            
            return all
                            
                        
        Tree = TreeToPythonList(Tree)
        print(Tree)
        writeList = json.dumps(Tree, ensure_ascii=False).decode('string_escape')
        List = writeList
                        
                
        
        # return outputs if you have them; here I try it for you:
        return List
# ---------- end treetolist ----------
icml = ICMLGenerator(DATA=treetolist, OPT=panel)
python = GhPythonScript(DATA=treetolist, OPT=panel)  # -> TABLE; inputs OPT: list
# ---------- python: Python ----------
from ghpythonlib.componentbase import executingcomponent as component
import Grasshopper, GhPython
import System
import Rhino
import rhinoscriptsyntax as rs

class MyComponent(component):
    def RunScript(self, DATA, OPT):
        """Provides a scripting component.
            Inputs:
                x: The x script variable
                y: The y script variable
            Output:
                a: The a output variable"""
        
        __author__ = "Andrew.Butler"
        __version__ = "2024.02.02"
        
        import sys
        import os
        user = os.environ['USERPROFILE']
        import json
        sys.path.append(r"\\sydsrv01\projects\Computational Design Group\93_Development\PackageManager\redback\py".format(**{'user':user}))
        import pyTableMaker as tm

        DATA = json.loads(DATA)
        if not OPT:
            OPT = {}
        else:
            OPT = json.loads("".join(OPT))
        TABLE = tm.table(DATA, OPT)
        # return outputs if you have them; here I try it for you:
        return TABLE
# ---------- end python ----------
write_file = WRITEFILE(content=python, filepath=panel_4, filename="testing2.icml", activate=Toggle(True))

# ==== cluster WRITEFILE: Writes files, also checks for python objects and converts them to text before writing.
activate = ClusterInput()
content = ClusterInput()
filename = ClusterInput()
filepath = ClusterInput()
python = GhPythonScript(CONTENT=content, FILEPATH=filepath, FILENAME=filename, ACTIVATE=activate)  # inputs CONTENT: list
# ---------- python: Python ----------
__author__ = "s-abutler"
__version__ = "2018.09.10"

import rhinoscriptsyntax as rs
from json import dumps
def check(o):
#    print(str(type(o)))
#    return o
    if str(type(o)) == "<type 'dict'>":
        return dumps(o)
    else:
        return o
if ACTIVATE:
    con = list(map(lambda u: check(u), CONTENT))
    conwrite = "\n".join(con)
    dir = FILEPATH+"\\"+FILENAME
    with open(dir,'wb') as f:
        f.write(conwrite.encode("UTF-8"))
# ---------- end python ----------
