# Grasshopper definition Redback SVG - Data - Tables.ghx (Grasshopper 1.0.8)
# plug-ins: RhinoCodePluginGH, treesloth01, Python

pop2d = Populate2D(
    Region={Plane=PlaneXY(6.059322034, -1.86440678, 0), Size=Domain2(u=-164.0677966..164.0677966, v=-108.1355932..108.1355932)},
    Count=100,
    Seed=1)
lng = ListLength(List=pop2d)
random = Random(Range=Domain(-180, 180), Number=lng, Seed=45362)
xy = XYPlane(Origin=pop2d)
prot = RotatePlane(Plane=xy, Angle=random)
panel = Panel("X:\93_Development\PackageManager\redback\components\ghContent\Icon-Geo2ArchiJSON.png")
X = XSize(Domain(-5, 5))
rectangle = Rectangle(Plane=prot, XSize=X, YSize=X, Radius=0)  # -> Rectangle, Length
text_object = IronPython2Script(PL=prot, TE="A")  # -> TO
# ---------- text_object: IronPython ----------
#### Constants ####
global __var__
__var__ = {
	"guid":"983d9511-87a8-479f-a688-dcef879bd7dc",
	
	"name":"Text Object",
	"nickname":"Text Object",
	"description":"Creates a text object that can be parsed by archJSON",
	"icon": "ghContent\\Icon-TextObject.png",

	"tabname":"Redback",
	"section":"ArchJSON",

	"inputs":[
		{"name":"Plane",		"nickname":"P",	"objectAccess":"item",	"description":"", },
		{"name":"Text",			"nickname":"T",	"objectAccess":"item",	"description":"", },
	],
	"outputs":[
		{"name":"Text Object",		"nickname":"O",	"description":"archJSON Text Object"},
	]
}
__author__ = "Andrew.Butler"
__version__ = "2024.02.02"
#### Constants ####
import Rhino as r
import rhinoscriptsyntax as rs
import json
P = PL
T = TE
class archJSONText:
    def __init__(self, location, content):
        self.location = location
        self.content = str(content)
    def __str__(self):
        return ("<ArchJSON String>: "+self.content)

TO = archJSONText(P,T)
# ---------- end text_object ----------
image_objet = IronPython2Script(RE=rectangle.Rectangle, IP=panel)  # -> IO
# ---------- image_objet: IronPython ----------
#### Constants ####
global __var__
__var__ = {
	"guid":"53cc467c-f4e5-4782-ac66-a8ce3084f988",
	
	"name":"Image Object",
	"nickname":"Image Object",
	"description":"Creates an image object that can be parsed by archJSON",
	"icon": "ghContent\\Icon-ImageObject.png",

	"tabname":"Redback",
	"section":"ArchJSON",

	"inputs":[
		{"name":"Rectangle",		"nickname":"R",	"objectAccess":"item",	"description":"", },
		{"name":"Image",			"nickname":"I",	"objectAccess":"item",	"description":"", },
	],
	"outputs":[
		{"name":"Image Object",		"nickname":"O",	"description":"archJSON Text Object"},
	]
}
__author__ = "Andrew.Butler"
__version__ = "2024.02.02"

R = RE
I = IP

import rhinoscriptsyntax as rs
import Rhino as r
import os



class archJSONImage:
    def __init__(self, rec, img):
        p = rs.CurvePoints(rec)
        self.location = rs.PlaneFromPoints(p[0],p[1],p[2])
        self.bounds = rs.BoundingBox(rec,self.location,False)
        self.width = self.bounds[2][0]
        self.height = self.bounds[2][1]
        self.img = str(img)
        self.fileDirectory, self.fileName = os.path.split(self.img)
    def __str__(self):
        return "<ArchJSON Image>: %s"%(self.fileName)

IO = archJSONImage(R,I)
# ---------- end image_objet ----------
charseq = CharSequence(Count=48, CharPool="ABCDEFGHIJKLMNOPQRSTUVWXYZ", Format="{0}")
partition = PartitionList(List=charseq, Size=24)
partition_2 = PartitionList(List=partition, Size=4)  # -> simplify(Chunks)
toggle = BooleanToggle(False)
panel_2 = Panel("""class
id
test""")
panel_3 = Panel("""class1
123
test""")
xy_2 = XYPlane(Origin=Point(0, 0, 0))
panel_4 = Panel("A3")
panel_5 = Panel("1:1")
panel_6 = Panel("{}")
circle = Circle([{Plane=Plane(origin=(-2.330508475, -0.9322033898, 0), x=(0.4472135955, 0.894427191, 0), y=(-0.894427191, 0.4472135955, 0)), Radius=12.50682089}, {Plane=Plane(origin=(14.44915254, 16.77966102, 0), x=(0.5144957554, 0.8574929257, 0), y=(-0.8574929257, 0.5144957554, 0)), Radius=10.87126624}, {Plane=Plane(origin=(30.29661017, 33.55932203, 0), x=(0.8192319205, 0.5734623444, 0), y=(-0.5734623444, 0.8192319205, 0)), Radius=11.37899252}, {Plane=Plane(origin=(46.1440678, 45.6779661, 0), x=(0.6459422415, 0.7633862854, 0), y=(-0.7633862854, 0.6459422415, 0)), Radius=15.8748517}, {Plane=Plane(origin=(68.51694915, 68.98305085, 0), x=(0.7525766947, 0.6585046079, 0), y=(-0.6585046079, 0.7525766947, 0)), Radius=9.909457961}, {Plane=Plane(origin=(85.29661017, 88.55932203, 0), x=(0.7071067812, 0.7071067812, 0), y=(-0.7071067812, 0.7071067812, 0)), Radius=7.910008061}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])
tstat = TreeStatistics(Tree=partition_2)  # -> Paths, Length, Count
create_json = IronPython2Script(K=panel_2, V=panel_3)  # -> JO; inputs K: list, V: list
# ---------- create_json: IronPython ----------
#### Constants ####
global __var__
__var__ = {
	"guid":"0e4b6507-e8be-483f-8d55-21c261e5bbcb",
	
	"name":"Create JSON",
	"nickname":"JSON",
	"description":"Creates a JSON string from a list of matching keys and values",
	"icon": "ghContent\\Icon-MakeJSON.png",

	"tabname":"Redback",
	"section":"JSON",

	"inputs":[
		{"name":"Keys",		"nickname":"K",	"objectAccess":"list",	"description":"List of Keys", },
		{"name":"Values",	"nickname":"V",	"objectAccess":"list",	"description":"List of Values", },
	],
	"outputs":[
		{"name":"JSON",		"nickname":"J",	"description":"JSON Output"},
	]
}
__author__ = "Andrew.Butler"
__version__ = "2024.02.02"
		
import json

if not K:
	K = []

if not V:
	V = []

values = [None]*len(K)
for i in range(len(V)):
	values[i] = V[i]

def convertObs(ob):
	try:
		ob = json.loads(ob)
		return ob
	except:
		return ob

values = list(map(lambda x: convertObs(x),values))



outdict = dict(zip(K,values))
JO = json.dumps(outdict)
# ---------- end create_json ----------
geo2arch = IronPython2Script(GE=text_object)  # -> JO; inputs GE: list, PR: list of String
# ---------- geo2arch: IronPython ----------
#### Constants ####
global __var__
__var__ = {
	"guid":"d276cba6-c7bd-4860-8d09-1c6b23a620d4",
	
	"name":"Geo2Ar",
	"nickname":"Wrapper",
	"description":"Wraps and joins text with selected data characters",
	"icon": "ghContent\\Icon-Geo2ArchiJSON.png",

	"tabname":"Redback",
	"section":"ArchJSON",

	"inputs":[
		{"name":"Geometry",			"nickname":"G",	"objectAccess":"list", "objectType":"GenericObject"	,"description":"List of Geometry to convert", },
		{"name":"Properties",		"nickname":"P",	"objectAccess":"list", "objectType":"String"		,"description":"List of Properties per geometry", },
	],
	"outputs":[
		{"name":"JSON",	"nickname":"J",	"description":"ArchiJSON representing the geometry"},
		#{"name":"CHECKGEOM", "nickname":"CHECKGEOM", "description":"ArchiJSON representing the geometry"},
		#{"name":"LOG", "nickname":"LOG", "description":"ArchiJSON representing the geometry"}
	]
}
__author__ = "Andrew.Butler"
__version__ = "2024.02.02"
import rhinoscriptsyntax as rs
import Rhino as rh
import scriptcontext as sc
import Grasshopper as g
import ghpythonlib as ghp
import json
#LOG = []
CHECKGEOM = []
#document = sc.doc
#sc.doc = rh.RhinoDoc.ActiveDoc
#sc.doc = ghdoc


def Point(geom,prop=None):
	pt = rs.coerce3dpoint(geom)
	pt = [pt[0],pt[1],pt[2]]
	if prop:
		pt = {"type":"Feature","geometry":{'coordinates':pt, 'type': 'Point'}}
		pt['properties'] = json.loads(prop)
		return pt
	else:
		return pt
def convertToRPT (geom):
	pt = rh.Geometry.Point3d(geom[0],geom[1],geom[2])
	return pt
def PointCollection(geom,prop=None):
	t = geom
	pts = map(lambda g: Point(g), t)
	crv = {"type":"Feature","geometry":{'coordinates':pts, 'type': 'PointCollection'}}
	if prop:
		crv['properties'] = json.loads(prop)
	#print(crv)
	return crv
	
def CurveCollection(geom,prop=None):
	t = geom
	#print('geom', geom)
	crvs = map(lambda g: Curve(g), t)
	#print("CURVE COLLECTION--- ", crvs)
	crvCol = {"type":"Feature","geometry":{'coordinates':crvs, 'type': 'CurveCollection'}}
	if prop:
		crvCol['properties'] = json.loads(prop)
	return crvCol
	
#    t = rs.CurvePoints(crvs)
#    tc = rs.ClosedCurveOrientation(crvs)
#    if tc == 0: tc = False
#    else: tc = True
#    tdeg = rs.CurveDegree(crvs)
#    tcPo = len(t)
#    #print("tdeg: ",tdeg)
#    #print("tcPo: ",tcPo)
#    pts = map(lambda g: Point(g), t)
#    crv = {"type":"Feature","geometry":{'coordinates':pts, 'type': 'CurveCollection','closed':tc}}
#    if tdeg == 1 and tc: del crv['geometry']['coordinates'][-1]
#    if tdeg == 1 and tcPo == 2  : crv['geometry']['type']='Line'
#    if tdeg >= 2                : crv['geometry']['type']='Spline'
#    if tdeg == 2 and tcPo == 3  :
#        #print("3ARC")
#        crv['geometry']['type']='Arc'
#    if tdeg == 2 and tcPo == 5  :
#        #print("5ARC")
#        arc = rs.AddArc3Pt(pts[0],pts[4],pts[2])
#        pt0 = convertToRPT(pts[0])
#        pt2 = convertToRPT(pts[2])
#        pt4 = convertToRPT(pts[4])
#        arc = rh.Geometry.Arc(startPoint = pt0, pointOnInterior = pt2, endPoint = pt4)
#        crv['geometry']['type']='Arc'
#        #print(crv['geometry']['coordinates'])
#        del crv['geometry']['coordinates'][3]
#        del crv['geometry']['coordinates'][1]
#    if prop:
#        crv['properties'] = json.loads(prop)
#    #print(crvcollection)
#    return crvcollection

def Plane(geom,prop=None):
	pln = {"type":"Feature","geometry":{'coordinates':[geom.XAxis.X,geom.YAxis.X,geom.ZAxis.X,geom.OriginX,geom.XAxis.Y,geom.YAxis.Y,geom.ZAxis.Y,geom.OriginY,geom.XAxis.Z,geom.YAxis.Z,geom.ZAxis.Z,geom.OriginZ,0,0,0,1], 'type': 'Xform'}}
	if prop:
		pln['properties'] = json.loads(prop)
	return pln
def Text(geom,prop=None):
	#print("TEXT")
	text = Plane(geom.location,prop)
	text['geometry']['type']="Text"
	text['geometry']['content']=geom.content
	return text
def Image(geom,prop=None):
	#print("Image")
	##print(dir(geom))
	image = Plane(geom.location,prop)
	image['geometry']['type']="Image"
	image['geometry']['image']=geom.img
	image['geometry']['width']=geom.width
	image['geometry']['height']=geom.height
	return image
def Curve(geom,prop=None):
	#print("Curve def")
	#print(geom, type(geom))
	if type(geom).__name__ == "Line":
		geom = ghp.components.RebuildCurve(geom,1,3,False)
	if type(geom).__name__ == "Circle":
		geom = geom.ToNurbsCurve()
	try:
		t = rs.CurvePoints(geom)
	except:
		t = []
	
	#print(t)
	#check if curve closed
	tc = rs.ClosedCurveOrientation(geom)
	if tc == 0: tc = False
	else: tc = True
	##print(dir(geom))
	#split = rs.ExplodeCurves(geom, True)
	##print(rs.CurveDegree(geom))
	#split = ghp.components.Explode(,True)
	##print("Split",split)
	tdeg = rs.CurveDegree(geom)
	tcPo = len(t)
	isArc = rs.IsArc(geom)
	isCirc = rs.IsCircle(geom)
	
	##print("isCirc: ",isCirc)
	pts = map(lambda g: Point(g), t) #object to points
	#print(pts)
	crv = {"type":"Feature","geometry":{'coordinates':pts, 'type': 'Spline','closed':tc, "deg":tdeg}}
	#print("tdeg: "+str(tdeg))
	#print("tcPo: "+str(tcPo))
	#print(crv)
	#print("isArc",isArc)
	#print("----------------------------------")
	if tdeg == 1 and tc  : del crv['geometry']['coordinates'][-1]
	if tdeg == 1 and tcPo == 2  : crv['geometry']['type']='Line'
	if tdeg >= 2                : crv['geometry']['type']='Spline'
	if tdeg == 2 and tcPo == 3  :
		#print("3ARC")
		crv['geometry']['deg']=tdeg
		# crv['geometry']['type']='Arc'
	#if tdeg == 2 and tcPo == 5  :
		#arc = rs.AddArc3Pt(pts[0],pts[4],pts[2])
		#pt0 = convertToRPT(pts[0])
		#pt2 = convertToRPT(pts[2])
		#pt4 = convertToRPT(pts[4])
		#arc = rh.Geometry.Arc(startPoint = pt0, pointOnInterior = pt2, endPoint = pt4)
		
		##print(crv['geometry']['coordinates'])
		#del crv['geometry']['coordinates'][3]
		#del crv['geometry']['coordinates'][1]
	if isArc:
		cpt = rs.ArcCenterPoint(geom)
		testCrvPts = rs.CurvePoints(geom)
		testCrvPts.append(testCrvPts[0])
		testCrv = rs.AddPolyline(testCrvPts)
		try:    isBig = bool(rs.PointInPlanarClosedCurve(cpt, testCrv))
		except: isBig = False
		cpt = Point(cpt)
		crd = rs.ArcRadius(geom)
		cang = rs.ArcAngle(geom)
		##print("cang",cang)
		crv['geometry']['type']='Arc'
		crv['geometry']['radius'] = crd
		crv['geometry']['isBig'] = isBig
		crv['geometry']['center'] = cpt
		crv['geometry']['angle'] = cang
	if isCirc:
		cpt = Point(rs.CircleCenterPoint(geom))
		crd = rs.CircleRadius(geom)
		crv['geometry']['type']='Circle'
		crv['geometry']['coordinates'] = cpt
		crv['geometry']['radius'] = crd
	if prop:
		crv['properties'] = json.loads(prop)
	#if not isArc and crv["geometry"]['type'] == "Arc":
		#crv['geometry']['type']='Spline'
#    if tdeg >= 2:
	#print (crv)
	return crv
def PolyCurve(geom, prop=None):
	##print(geom)
	
	#print("PolyCurve def")
	#print(geom, type(geom))
	if str(type(geom)) != "<type 'List[object]'>":
		geom = [geom]
	polyCurveParts = []
	#for d in dir(geom):
	#    #print(d)

	for part in geom:
		#print(part)
		tc = rs.ClosedCurveOrientation(part)
		part = part.Explode()
		curves = list(map(lambda x: Curve(x, {})["geometry"], part))
		polycrvPart = {"type":"Feature","geometry":{'coordinates':curves, 'type': 'PolyCurvePart','closed':tc}}
		polyCurveParts.append(polycrvPart)
	polycrv = {"type":"Feature","geometry":{'coordinates':polyCurveParts, 'type': 'PolyCurve'}}
	if prop:
		polycrv['properties'] = json.loads(prop)
	return polycrv

	return crvCol
otype = {
		"PolyCurve": Curve,
		"Line": Curve,
		"LineCurve": Curve,
		"NurbsCurve": Curve,
		"ArcCurve": Curve,
		"Circle": Curve,
		"PolylineCurve": Curve,
		"0": "Unknown object",
		"1": Point,
		"2": "PointCloud",
		"3": PointCollection,
		"4": Curve,
		"5": Plane,
		"6": Text,
		"7": CurveCollection,
		"8": "Surface",
		"9": Image,
		"16": "Polysurface",
		"32": "Mesh",
		"256": "Light",
		"512": "Annotation",
		"4096": "Instance reference",
		"8192": "Text dot",
		"16384": "Grip",
		"32768": "Detail",
		"65536": "Hatch",
		"131072": "Morph control",
		"134217728": "Cage",
		"268435456": "Phantom",
		"536870912": "Clipping plane",
		"1073741824": "Extrusion"}
def Convert(geom,prop):
	#print("START CONVERT")
	#print("SC",geom, type(geom))
	ot = otype["1"]
	try:
		#print(type(geom))
		#print("-"*100)
		ot = otype[str(type(geom).__name__)]
		try:
			if ot.__name__ == "Curve":
				try:
					ngeom = rs.coercegeometry(geom)
					ngeom = ghp.components.Explode(geom, True)
					ngeom = ghp.components.JoinCurves(geom["segments"],True)
					geom = ngeom
				except Exception as e:
					pass
				#print("after explode",geom)
				othertype = str(type(geom))
				##print("othertype", othertype)
				if othertype == "<type 'PolyCurve'>":
					ot = PolyCurve
					##print("POLYCURVE")
				if othertype == "<type 'Line'>":
					ot = Curve
		except Exception as e:
			#print("e",e)
			pass
		
		
	except Exception as e:
		#print("1:", e)
		#ot = otype[type(geom)]
		othertype = str(type(geom))
		print("othertype" ,othertype)
		if othertype == "<type 'List[object]'>":
			"object is in a List"
			innertype = str(type(geom[0]))
			#print("innertype",innertype,)
			#if innertype=="<type 'PolylineCurve'>":
				##print("PCrv")
				#ot = otype["7"]
			#if innertype=="<type 'PolyCurve'>":
				##print("PolyCrv")
				#ot = PolyCurve
			if "Curve" in innertype:
				#print("PCrv")
				ot = otype["7"]
			if innertype=="<type 'Point3d'>":
				#print("PT3D")
				ot = otype["3"]
		if othertype == "<type 'Plane'>":
			ot = otype["5"]
		othertype = str(geom.__class__.__name__)
		#print("othertype" ,othertype)
		if othertype == "archJSONText":
			ot = otype["6"]
		if othertype == "archJSONImage":
			ot = otype["9"]
		if othertype == "<type 'instance'>":
			if geom.type == "text":
				ot = otype["6"]
			if geom.type == "image":
				ot = otype["9"]
	#print("OBJECT TYPE ---- ", ot)
	#print("GEOM ---- ", geom,type(geom))
	return(ot(geom,prop)
		)

if not PR:
    PR = ["{}"]
fillP = ["{}"]*len(GE)
for i, prop in enumerate(PR):
	fillP[i] = prop

print(GE)

fullProps = [PR[-1]]*len(GE)

for i in range(len(PR)):
    fullProps[i] = PR[i]

features = list(map(lambda g,p: Convert(g,p), GE,fullProps))

	
JO = json.dumps({"type":"FeatureCollection", "features":features})

#class dictionaryObject(dict):
	#pass
	#def __str__(self):
		#return "<d>"

#dictTest = dictionaryObject({"hello":"world"})

#print(dir(dictTest))
#print(dictTest.__str__)

#DO = dictTest
# ---------- end geo2arch ----------
svg_layout = IronPython2Script(P=xy_2, D="A3", S="1:1", L=1)  # -> L, R; inputs P: Plane, D: String, S: String
# ---------- svg_layout: IronPython ----------
#### Constants ####
global __var__
__var__ = {
	"guid":"bb0530c2-d04f-4c52-8fb1-7f81d876a193",
	
	"name":"SVG Layout",
	"nickname":"SVG Layout",
	"description":"Creates a SVG layout dictionary",
	"icon": "ghContent\\Icon-SVGLayout.png",

	"tabname":"Redback",
	"section":"SVG",

	"inputs":[
		{"name":"Plane",		"nickname":"P",	"objectAccess":"item",	"description":"", },
		{"name":"Dimensions",	"nickname":"D",	"objectAccess":"item",	"description":"", },
		{"name":"Scale",		"nickname":"S",	"objectAccess":"item",	"description":"", },
		{"name":"Location",		"nickname":"L",	"objectAccess":"item",	"description":"", },
	],
	"outputs":[
		{"name":"Layout",		"nickname":"L",	"description":"JSON Layout"},
		{"name":"Rectangle",	"nickname":"R",	"description":"Page Border"},
	]
}
__author__ = "Andrew.Butler"
__version__ = "2024.02.02"
#### Constants ####

import json
import scriptcontext as sc
import rhinoscriptsyntax as rs
import Rhino



millimeters = sc.doc.ModelUnitSystem.Millimeters
currentUnits = sc.doc.ModelUnitSystem


#### This assumes base units as millimeters

unitRatio = Rhino.RhinoMath.UnitScale(millimeters, currentUnits)

pageLUT = {
"A5":		(210,148),
"A5 (L)":	(210,148),
"A5 (P)":	(148,210),
"A4":		(297,210),
"A4 (L)":	(297,210),
"A4 (P)":	(210,297),
"A3":		(420,297),
"A3 (L)":	(420,297),
"A3 (P)":	(297,420),
"A2":		(594,420),
"A2 (L)":	(594,420),
"A2 (P)":	(420,594),
"A1":		(841,594),
"A1 (L)":	(841,594),
"A1 (P)":	(594,841),
"A0":		(1189,841),
"A0 (L)":	(1189,841),
"A0 (P)":	(841,1189),
}

plane = P
location = L
scale = S

DIM = D
if not DIM:
	DIM = "A3 (L)"
if location == None:
	location = True
if scale == None:
	scale = "1:1"

pageScale = float(scale.split(":")[1])/float(scale.split(":")[0])

if DIM in pageLUT:
	width, height = pageLUT[DIM]
elif DIM.replace(",","").isdigit():
	width, height = tuple(DIM.split(","))


combScale = unitRatio*pageScale
swidth = float(width)*combScale
sheight = float(height)*combScale

print(width, height)


#print(dir(plane))
#print(plane.PointAt.__doc__)
print("location", location)
if P:
    if location:
	    positionedPlaneOrig = plane.PointAt(swidth/-2.0,sheight/-2.0,0)
	    svgPlaneOrig = plane.PointAt(swidth/-2.0,sheight/2.0,0)
    else:
	    positionedPlaneOrig = plane.PointAt(0,-sheight,0)
	    svgPlaneOrig = plane.PointAt(0,0,0)
    print(positionedPlaneOrig)
    plane.Origin = positionedPlaneOrig
    #print(rs.AddRectangle.__doc__)
    R = rs.AddRectangle(plane,swidth,sheight )
    plane.Origin = svgPlaneOrig
    p = plane
    L = json.dumps({"plane":[[p.Origin[0],p.Origin[1],p.Origin[2]],[p.XAxis[0],p.XAxis[1],p.XAxis[2]],[p.YAxis[0],p.YAxis[1],p.YAxis[2]]], "page":[width,height], "scale":combScale})
# ---------- end svg_layout ----------
lng_2 = ListLength(List=tstat.Paths)
json_keys = IronPython2Script(JO=create_json)  # -> K; inputs JO: String
# ---------- json_keys: IronPython ----------
#### Constants ####
global __var__
__var__ = {
	"guid":"c2790a28-9f47-43da-a0c7-538cae087e63",
	
	"name":"JSON Keys",
	"nickname":"JSON Keys",
	"description":"Returns all surface keys from a JSON string",
	"icon": "ghContent\\Icon-JSONKeys.png",

	"tabname":"Redback",
	"section":"JSON",

	"inputs":[
		{"name":"JSON",			"nickname":"J",	"objectAccess":"item",	"description":"JSON object to read", },
	],
	"outputs":[
		{"name":"Keys",	"nickname":"K",	"description":"Surface level keys."}
	]
}
__author__ = "Andrew.Butler"
__version__ = "2024.02.02"
			   
import json

if not JO:
	JO = "{}"
K = list(json.loads(JO))
# ---------- end json_keys ----------
merge = Merge(Data1=create_json, Data2=create_json)
charseq_2 = CharSequence(Count=lng_2, CharPool="ABCDEFGHIJKLMNOPQRSTUVWXYZ", Format="{0}")
long = LongestList(ListA=partition_2, ListB=graft(charseq_2), PaddingMode=2)  # -> ListA, simplify(graft(ListB))
read_json = IronPython2Script(JO=merge, K=json_keys)  # -> V; inputs JO: list of String, K: String
# ---------- read_json: IronPython ----------
#### Constants ####
global __var__
__var__ = {
	"guid":"33f7772a-c9ff-4356-915e-6a0b99bf4fcc",
	
	"name":"Read JSON",
	"nickname":"Read JSON",
	"description":"Reads keys from a JSON string. It can use javascript style key notation (a.b.c)",
	"icon": "ghContent\\Icon-ReadJSON.png",

	"tabname":"Redback",
	"section":"JSON",

	"inputs":[
		{"name":"JSON",			"nickname":"J",	"objectAccess":"list",	"description":"JSON object to read", },
		{"name":"Key",			"nickname":"K",	"objectAccess":"item",	"description":"Key to access from JSON", },
	],
	"outputs":[
		{"name":"Value",	"nickname":"V",	"description":"Returned value from JSON"}
	]
}
__author__ = "Andrew.Butler"
__version__ = "2024.02.02"
import json
def deepGet(key, object):
	try:
		keylist = key.split(".")
		for ki, k in enumerate(keylist):
			try: k = int(k)
			except: pass
			print(k,type(k))
			if ki < len(keylist)-1:
				if type(k) == type("") and k not in object:
					object[k] = {}
				object = object[k]
			else:
				print("last",k, object)
				returnOb = object[k]
				return returnOb
	except Exception as e:
		print(e)
		return None
		
		
out = []
if not JO:
	JO = []
for o in JO:
	o = json.loads(o)
	#apob = list(map(lambda x: deepGet(x,o), K))
	apob = deepGet(K,o)
	if type(apob) == type([]) or type(apob) == type({}):
		apob = json.dumps(apob)
	
	#for i, ob in enumerate(apob):
		#if type(ob) == type([]) or type(ob) == type({}):
			#ob = json.dumps(ob)
		#apob[i] = ob
	#print(apob)
	out.append(apob)
		
V = out
# ---------- end read_json ----------
svg = IronPython2Script(JO=geo2arch, LA=svg_layout.L)  # -> SVG; inputs JO: list of String, LA: String, CSS: String
# ---------- svg: IronPython ----------
#### Constants ####
global __var__
__var__ = {
    "guid":"6d71b3c9-aa54-477b-8810-e70e61a39418",
    
    "name":"SVG Generator",
    "nickname":"SVG",
    "description":"Converts ArchiJSON to SVG",
    "icon": "ghContent\\Icon-SVGGenerator.png",

    "tabname":"Redback",
    "section":"SVG",

    "inputs":[
        {"name":"Geometry",			"nickname":"J",	"objectAccess":"list",	"description":"", },
        {"name":"Properties",		"nickname":"L",	"objectAccess":"item",	"description":"", },
        {"name":"Properties",		"nickname":"C",	"objectAccess":"list",	"description":"", },
    ],
    "outputs":[
        {"name":"SVG",	"nickname":"S",	"description":"SVG"},
        {"name":"LOG",	"nickname":"LOG",	"description":"LOG"},
    ]
}
__author__ = "Andrew.Butler"
__version__ = "2024.02.02"

import rhinoscriptsyntax as rs
import sys
import json
import inspect
import Rhino as r
from string import Template

LOG = []
#The inputs to this node will be stored as a list in the IN variables.
ARCHIJSON = JO
LAYOUT = LA

def errorLog(e, log=[]):
    import os, sys
    exc_type, exc_obj, exc_tb = sys.exc_info()
    other = sys.exc_info()[0].__name__
    fname = os.path.split(exc_tb.tb_frame.f_code.co_filename)[1]
    errorType = str(exc_type)
    errob = {"isError": True, "error":str(e), "errorType":errorType, "function":fname, "line":exc_tb.tb_lineno, "log":log}
    return errob

def checkRB(ob):
    if type(ob) == type(""):
        return json.loads(ob)
    else:
        return ob

ARCHIJSON = list(map(lambda u: checkRB(u),ARCHIJSON))

array = []
def featurecollection(o):
    print ('o', o)
    for i in o["features"]:
        print ('i', i['geometry']['type'], i, )
        #print("FEATURES---- ", i)
        
        fCall = function_mappings[i['geometry']['type']]
        props = {}
        try:
            props = i['properties']
        except:
            pass
        li = []
        li.append(i)
        obarray.append(fCall(li,props))
def feature(o):
    pass
    
def point(o,pointType="standard"):
    try:
        print(o)
        pt = r.Geometry.Point3d(o[0],o[1],o[2])
        remap = r.Geometry.Plane.RemapToPlaneSpace(lPlane, pt)
        rpt = remap[1]
        rpt = [rpt[0]/layout['scale'],-1*rpt[1]/layout['scale'],rpt[2]/layout['scale']]
        ptx = str(remap[1][0]/layout['scale'])
        pty = str(remap[1][1]/layout['scale']*-1)
        pt = "%s, %s" %(ptx, pty)
        ppt = "%s %s" %(ptx, pty)
        ptypes = {
            "standard": "%s, %s" %(ptx, pty),
            "plane": [rpt[0]/layout['scale'],-1*rpt[1]/layout['scale'],rpt[2]/layout['scale']],
            "rplane": [rpt[0], rpt[1], rpt[2]],
            "line": [float(ptx),float(pty),0],
            "path": "%s %s" %(ptx, pty)
        }
        return ptypes[pointType]
    except: return []
    

def isCClockwise(pts):
    total = 0
    #print(pts)
    for index in range(len(pts)):
        p1 = pts[index]
        p2 = pts[(index+1) % len(pts)]
        
        f = (p2[0]-p1[0])*((p2[1]*-1)+(p1[1]*-1))
        total += f
        #print("t",total, p1,p2)
    
    cclockwise = total < 0
    #print("cclockwise:",cclockwise)
    return cclockwise

def arc(o, props, collection = False):
    #print(o)
    #<path d="M 80 80 A 45 45, 0, 0, 0, 125 125">
    arcList = []
    for items in o:
        items = items['geometry']
        pts = map(lambda i: point(i,'line'), items['coordinates'])

        radius = items["radius"]
        angle = items["angle"]
        cclockwise = isCClockwise(pts)
        isBig = items["isBig"]
        largeCircleFlag = str(int(cclockwise))
        
        testflag = False
        largeCircleFlag = True
        if not isBig and cclockwise:
            testflag = False
            largeCircleFlag = False
        if not isBig and not cclockwise:
            testflag = True
            largeCircleFlag = False
        if isBig and not cclockwise:
            testflag = True
            largeCircleFlag = True
        if isBig and cclockwise:
            testflag = False
            largeCircleFlag = True
        largeCircleFlag = str(int(largeCircleFlag))
        testflag = str(int(testflag))
        
        #print(largeCircleFlag,testflag)
        propString = []
        for k in props:
            propString.append(str(k)+'=\"'+str(props[k])+'\"')
        pString = " ".join(propString)
        pString = pString.split('="')
        pString = pString[0] + '= "fill:none;' + pString[1]
        arc = '<path d="M %.2f %.2f A %.2f %.2f, 0, %s, %s, %.2f %.2f" %s/>'%(pts[0][0],pts[0][1],radius,radius,largeCircleFlag,testflag,pts[-1][0],pts[-1][1],pString)
        #pline = NurbsCurve.ByControlPoints(polarray,1,o['properties']['closed'])
        arcList.append(arc)
    arcList = " ".join(arcList)
    return arcList

def line(o, props, collection = False):
    #<polyline points="118.85,155.3 118.85,180.7" class="FOPActual" zindex="10"/>
    ptList = []
    for items in o:
        items = items['geometry']
        #print(o)
        pts = map(lambda i: point(i, "line"), items['coordinates'])
        propString = []
        for k in props:
            #print(k)
            #print(props[k])
            propString.append(str(k)+'=\"'+str(props[k])+'\"')
        pString = " ".join(propString)
        pline = '<line x1="'+str(pts[0][0])+'" y1="'+str(pts[0][1])+'" x2="'+str(pts[1][0])+'" y2="'+str(pts[1][1])+'" '+pString+'/>'
        #pline = NurbsCurve.ByControlPoints(polarray,1,o['properties']['closed'])
        
        ptList.append(pline)
    ptList = " ".join(ptList)
    return ptList

def polyline(o, props, closed = False ,collection = False):
    #<polyline points="118.85,155.3 118.85,180.7" class="FOPActual" zindex="10"/>
    ptList = []
    pStringList = []
    #print(o)
    for cords in o:
        closed = cords['geometry']['closed']
        #print("CORDS ---", cords)
        polarray = []
        for p in cords['geometry']['coordinates']:
            pt = point(p)
            polarray.append(pt)
        
        pts = " ".join(polarray)
        propString = []
    
        for k in props:
            propString.append(str(k)+'=\"'+str(props[k])+'\"')
        pString = " ".join(propString)
        if collection == True:
            if closed:
                pts = "M %s Z" % (pts)
            else: pts = "M %s" % (pts)
        ptList.append(pts)
        pStringList.append(pString)
    pStringList = " ".join(pStringList)
    if not closed:
        if pString:
            pString = pString.split('="')
            pString = pString[0] + '= "fill:none;' + pString[1]
    ptList = " ".join(ptList)
    if collection == True: 
        pline = '<path d=\"'+ptList+'\"  '+ pString +'/>'
    else:
        if closed:
            pline = '<polygon points=\"'+ptList+'\" '+pStringList+'/>'
        else:
            pline = '<polyline points=\"'+ptList+'\" '+pString+'/>'
            #pline = NurbsCurve.ByControlPoints(polarray,1,o['properties']['closed'])

    return pline
    
def curvecollection(o, props):
    #<path d="M10 10 H 90 V 90 H 10 L 10 10"/>
    #print("CURVE COLLECTION")
    
    o = o[0]["geometry"]["coordinates"]
    #print(o)
    # in types in o["coordinates"]
    typeDic = {}
    for items in  o:
        print ("ITEM ", items)
        groupType = items['geometry']['type']
        if typeDic.has_key(str(groupType)):
            typeDic[str(groupType)].append(items)
        else:
            typeDic[str(groupType)] = [items]
    #print("GROUP BY TYPES --", typeDic)
    
    ptListCombined = []
    for typeKey in typeDic:
        fCall = function_mappings[str(typeKey)] #get group type
        #typeDicList.append(typeDic[str(typeKey)])
        ptList = fCall(typeDic[str(typeKey)], props, collection = True)
        ptListCombined.append(ptList)
    
    ptListCombined = ' '.join(ptListCombined)
    return ptListCombined
    
def avgpts(p1, p2, w1=0.5, w2=0.5):
    p3 = []
    #LOG.append(" "*20+"avgpts"+str([p1,p2,w1,w2]))
    for p1p, p2p in zip(p1, p2):
        p3.append((p1p*w1)+(p2p*w2))
    #LOG.append(" "*20+"avgpts"+str([p3]))
    return p3
def spline_1deg(initCoords, props, outType=None, closed = True, skipFirst = False):
    try:
        polarray = []
        #print("spline_1deg",initCoords)
        initCoords = [initCoords]
        knotPtsList = initCoords
        beizerPtsList = []
        coordStringList = []
        #LOG.append(" knotPtsList --- "+str(knotPtsList))#########################################################
        
        for sPts in initCoords:
            coordString = []
            start = sPts.pop(0)
            start = point(start, 'line')
            start = start[:-1]
            start = list(map(lambda x: "{:.2f}".format(float(x)), start))
            if not skipFirst:
                coordString.append(" M"+",".join(start))
            for pts in sPts:
                pts = point(pts, 'line')
                pts = list(map(lambda x: "{:.2f}".format(float(x)), pts))
                pts = pts[:-1]
                coordString.append(" L"+",".join(pts))

            coordString = "".join(coordString)
            #LOG.append(" coordString --- "+str(coordString))#########################################################
            if closed:
                coordString = coordString+"Z"
            coordStringList.append(coordString)
        #LOG.append(" coordStringList --- "+str(coordStringList))#########################################################
        propString = []
        for k in props:
            propString.append(str(k)+'=\"'+str(props[k])+'\"')
        pString = " ".join(propString)
        coordStringList = " ".join(coordStringList)
        pline = '<path d="'+coordStringList+'" '+pString+'/>'
        #pline = NurbsCurve.ByControlPoints(polarray,1,o['properties']['closed'])
        #LOG.append("pline"+str(pline))#########################################################
        #print("bp",bezierPts)    
        if outType == "coordinates":
            return coordStringList
        else:
            return pline
    except Exception as e:
        print(e)
        LOG.append(e)
        return "<>"
        pass

def spline_2deg(initCoords, props, outType=None, closed = True, skipFirst = False):
    polarray = []
    
    print("SPLINE COORDS -- ", initCoords)
    initCoords = [initCoords]
    knotPtsList = []
    beizerPtsList = []
    
    for index, p in enumerate(initCoords):
        for indvPts in p:
            
            pnt = point(indvPts, 'line')
            pt = [pnt[0],pnt[1]]
            polarray.append(pt)
            polarray_len = len(polarray)
        bezierPts = []
        knotPts = []
        print("polLen",polarray_len)
        if closed:
            print("closed")
            for index in range(polarray_len-1):
                pt1 = polarray[index % len(polarray)]
                pt2 = polarray[(index+1) % len(polarray)]
                pt3 = polarray[(index+2) % len(polarray)]
                
                pt4 = avgpts(pt1,pt2,(1.0/6.0),(5.0/6.0))
                pt5 = avgpts(pt2,pt3,(5.0/6.0),(1.0/6.0))
                #print("par",pt1,pt2,pt3,pt4)
                bezierPts.append(pt4)
                bezierPts.append(pt5)
                a = bezierPts
            #fpoint = bezierPts.pop(0)
            #bezierPts.append(fpoint)
            # fpoint = bezierPts.pop(0)
            bezierPts = bezierPts[:-2]
            for index in range(int(len(bezierPts)/2.0)):
                index = index*2
                pt1 = bezierPts[(index+1) % len(bezierPts)]
                pt2 = bezierPts[(index+2) % len(bezierPts)]
                #print("avg",index,index+1,pt1,pt2)
                knotPts.append(avgpts(pt1,pt2))
            #bezierPts.append(fpoint)
            #bezierPts = bezierPts[-1:]+bezierPts[:-1]
            knotPts = knotPts[-1:]+knotPts[:-1]
            knotPts = knotPts+[knotPts[0]]
        else:
            mode = "normal"
            if len(polarray) == 3:
                mode = "3pt"
            print("_"*10+mode)
            #print("p",len(polarray),polarray)
            #if mode == "normal":
                #apPt = avgpts(polarray[0],polarray[1],1.0/3.0,2.0/3.0)
                #bezierPts.append(apPt)
            if mode == "3pt":
                apPt1 = avgpts(polarray[0],polarray[1],(1.0/3.0),(2.0/3.0))
                apPt2 = avgpts(polarray[1],polarray[2],(2.0/3.0),(1.0/3.0))
                bezierPts.append(apPt1)
                bezierPts.append(apPt2)
            if mode == "normal":
                for index in range(int((polarray_len-1)/2)):
                    index = index*2
                    print("index",index)
                    p1 = avgpts(polarray[index+0],polarray[index+1],(1.0/3.0),(2.0/3.0))
                    p2 = avgpts(polarray[index+1],polarray[index+2],(2.0/3.0),(1.0/3.0))
                    print("bez",p1)
                    bezierPts.append(p1)
                    bezierPts.append(p2)
            if mode == "normal":
                bezierPts.append(avgpts(polarray[-1],polarray[-2],1.0/3.0,2.0/3.0))
            #print(len(bezierPts),bezierPts)
            knotPts = [polarray[0]]+knotPts
            if mode == "normal":
                for index in range(int((len(bezierPts)-2)/2.0)):
                    index = (index*2)+1
                    p1 = bezierPts[index]
                    p2 = bezierPts[index+1]
                    p3 = avgpts(p1,p2)
                    #print("kp",index,p1,p2)
                    knotPts.append(p3)
            knotPts.append(polarray[-1])
        knotPtsList.append(knotPts)
        beizerPtsList.append(bezierPts)
    #print("knotPtsList",knotPtsList)
    #print("beizerPtsList",beizerPtsList)
    coordStringList = []
    #print(len(knotPts),knotPts)
    #print(len(bezierPts),bezierPts)
    for sPts in range(len(knotPtsList)):
        splineCoords = []
        #print('SPTS == ', sPts)
        knotPts = knotPtsList[sPts]
        bezierPts = beizerPtsList[sPts]
        #print("KNOTS --- ", knotPts)
        
        for index, knotPt in enumerate(knotPts):
            rspoints = [knotPt]
            try:
                if index == 0:  rspoints = [knotPt, bezierPts[index*2], bezierPts[(index*2)+1]]
                else:           rspoints = [knotPt, bezierPts[(index*2)+1]]
            except: pass
            for rspoint in rspoints:
                for coord in rspoint:
                    splineCoords.append("%.2f"%(coord))
        coordString= []
        if not skipFirst:
            coordString= ["M"]

        coordString = coordString+list(" , ".join(splineCoords))
        delimIndex = 0
        for index, char in enumerate(coordString):
            #print(index, char)
            if char == ",":
                if delimIndex == 1:
                    if not skipFirst:
                        coordString[index] = "C"
                    else:
                        coordString[index] = "~C"

                if (delimIndex-7) % 4 == 0 and delimIndex >= 7:
                    coordString[index] = "S"
                delimIndex += 1
        coordString = "".join(coordString)
        print("-"*20, coordString)
        if closed:
            coordString = coordString+"Z"
        coordStringList.append(coordString)
    propString = []
    for k in props:
        propString.append(str(k)+'=\"'+str(props[k])+'\"')
    pString = " ".join(propString)
    coordStringList = "".join(coordStringList)
    if skipFirst:
        coordStringList = coordStringList.split("~")[1]
    pline = '<path d="'+coordStringList+'" '+pString+'/>'
    #print(pline)
    #pline = NurbsCurve.ByControlPoints(polarray,1,o['properties']['closed'])
    if outType == "coordinates":
        print("coordStringList"+"__"+str(coordStringList))
        return coordStringList
    else:
        return pline
    
def spline_3deg(initCoords, props, outType=None, closed = True, skipFirst = False):
    #<polyline points="118.85,155.3 118.85,180.7" class="FOPActual" zindex="10"/>
    polarray = []
    #LOG.append("CLOSED ---"+str(closed))#########################################################
    #LOG.append("SPLINE COORDS -- "+str(initCoords['coords']))####################################
    initCoords = [initCoords]
    
    knotPtsList = []
    beizerPtsList = []
    for indvCoords in initCoords:
        polarray = []
        #LOG.append("SPLINE COORD -- "+str(indvCoords))###########################################
        for index, p in enumerate(indvCoords):
            pnt = point(p, type = 'line')
            #LOG.append("   pnt ----- "+str(pnt))
            
            pt = [pnt[0],pnt[1]]
            #print('pnt', pnt)
            #print('pt', pt)
            polarray.append(pt)
        polarray_len = len(polarray)
        bezierPts = []
        knotPts = []
        #LOG.append("  polarray ---- "+str(polarray))
        if closed:
            for index in range(polarray_len-1):
                pt1 = polarray[index]
                pt2 = polarray[(index+1) % len(polarray)]
                pt3 = avgpts(pt1,pt2,float(2.0/3.0),float(1.0/3.0))
                pt4 = avgpts(pt1,pt2,float(1.0/3.0),float(2.0/3.0))
                #print("par",pt1,pt2,pt3,pt4)
                #LOG.append(" "*10+"pt3,pt4 ----- "+str([pt3,pt4]))
                bezierPts.append(pt3)
                bezierPts.append(pt4)
            
            fpoint = bezierPts.pop(0)
            bezierPts.append(fpoint)
            #print(bezierPts)
            #LOG.append("   bezierPts ----- "+str(bezierPts))
            #LOG.append("   runningKnots")
            for index in range(int(len(bezierPts)/2.0)-1):
                index = index*2
                pt1 = bezierPts[index]
                pt2 = bezierPts[(index+1) % len(bezierPts)]
                #print("avg",index,index+1,pt1,pt2)
                avgresult = avgpts(pt1,pt2)
                #LOG.append("   avgresult ----- "+str(avgresult))
                knotPts.append(avgresult)
            fpoint = bezierPts.pop(0)
            bezierPts.append(fpoint)
            #print("bpts", bezierPts)
        else:
            mode = "normal"
            if len(polarray) == 4:
                mode = "4pt"
            #LOG.append("  mode ---- "+str(mode))
            if mode == "normal":
                bezierPts.append(avgpts(polarray[1],polarray[2]))
            for index in range(polarray_len-5):
                bezierPts.append(avgpts(polarray[index+2],polarray[index+3],float(2.0/3.0),float(1.0/3.0)))
                bezierPts.append(avgpts(polarray[index+2],polarray[index+3],float(1.0/3.0),float(2.0/3.0)))
            if mode == "normal":
                bezierPts.append(avgpts(polarray[-2],polarray[-3]))
            #LOG.append("   adding to knotPts ----- "+str(polarray[0])+str(knotPts))
            knotPts = [polarray[0]]+knotPts
            if mode == "normal":
                for index in range(int(len(bezierPts)/2.0)):
                    index = index*2
                    p1 = bezierPts[index]
                    p2 = bezierPts[index+1]
                    p3 = []
                    for p1p, p2p in zip(p1, p2):
                        p3.append((p1p*(1.0/2.0))+(p2p*(1.0/2.0)))
                    knotPts.append(p3)
            knotPts.append(polarray[-1])
            bezierPts = [polarray[1]]+bezierPts
            bezierPts.append(polarray[-2])
    
            #print('SPLINE OBJECT --', splineObject)
        beizerPtsList.append(bezierPts)
        knotPtsList.append(knotPts)
    
    coordStringList = []
    #LOG.append(" knotPtsList --- "+str(knotPtsList))#########################################################
    for sPts in range(len(knotPtsList)):
        splineCoords = []
        #print(sPts)
        knotPts = knotPtsList[sPts]
        bezierPts = beizerPtsList[sPts]
        #print("KNOTS --- ", knotPts)
        for index, knotPt in enumerate(knotPts):
            #print(index)
            #print(len(knotPts))
            rspoints = [knotPt]
            try:
                if index == len(knotPts)-1: pass
                elif index == 0:  rspoints = [knotPt, bezierPts[index*2], bezierPts[(index*2)+1]]
                else:           rspoints = [knotPt, bezierPts[(index*2)+1]]
            except: pass
            #print("RS POINTS --- ", rspoints)
            for rspoint in rspoints:
                for coord in rspoint:
                    splineCoords.append("%.2f"%(coord))
        #print (splineCoords)
        # #LOG.append(" splineCoords --- "+str(splineCoords))#########################################################
        if not skipFirst:
            coordString = ["M"]+list(" , ".join(splineCoords))
        
        delimIndex = 0
        for index, char in enumerate(coordString):
            if char == ",":
                if delimIndex == 1:
                    coordString[index] = "C"
                if (delimIndex-7) % 4 == 0 and delimIndex >= 7:
                    coordString[index] = "S"
                delimIndex += 1
        coordString = "".join(coordString)
        #LOG.append(" coordString --- "+str(coordString))#########################################################
        if closed:
            coordString = coordString+"Z"
        coordStringList.append(coordString)
    #LOG.append(" coordStringList --- "+str(coordStringList))#########################################################
    propString = []
    for k in props:
        propString.append(str(k)+'=\"'+str(props[k])+'\"')
    pString = " ".join(propString)
    coordStringList = " ".join(coordStringList)
    pline = '<path d="'+coordStringList+'" '+pString+'/>'
    #pline = NurbsCurve.ByControlPoints(polarray,1,o['properties']['closed'])
    #LOG.append("pline"+str(pline))#########################################################
    #print("bp",bezierPts)    

    if outType == "coordinates":
        return coordStringList
    else:
        return pline
    
def spline(o, props, outType=None, collection = False):
    LOG.append("spline")
    try:
        
        splineFuncs = {
        "spline_1deg" : spline_1deg,
        "spline_2deg" : spline_2deg,
        "spline_3deg" : spline_3deg,
        }
        splineObject = ""
        
        for segmentIndex, coords in enumerate(o):
            if "geometry" in coords:
                coords = coords["geometry"]
            deg = coords["deg"]
            print("coords",deg)
            func = splineFuncs["spline_"+str(deg)+"deg"]
            skipFirst = True
            if segmentIndex == 0:
                skipFirst = False
            appendSpline = func(coords["coordinates"], props, outType, closed = coords['closed'], skipFirst=skipFirst)
            print(appendSpline)
            splineObject = splineObject+appendSpline
            #print("splineObject",splineObject)

            #try:
                #coords = coords['geometry']
            #except:
                #pass
            #if coords['deg'] == 1:
                #initCoords1d['coords'].append(coords['coordinates'])
                #initCoords1d['closed'] = coords['closed']        
            #if coords['deg'] == 2:
                #initCoords2d['coords'].append(coords['coordinates'])
                #initCoords2d['closed'] = coords['closed']        
            #if coords['deg'] == 3:
                #initCoords3d['coords'].append(coords['coordinates'])
                #initCoords3d['closed'] = coords['closed']

            #print(initCoords3d)
        
        #if len(initCoords1d['coords']) >= 1:
            #print ("1 degree")
            #splineObject = spline_1deg(initCoords1d, props, outType, closed = initCoords1d['closed'])

        #if len(initCoords2d['coords']) >= 1:
            #print ("2 degree")
            #splineObject = spline_2deg(initCoords2d, props, outType, closed = initCoords2d['closed'])
            
        #elif len(initCoords3d['coords']) >= 1:
            #print ("3 degree")
            #splineObject = spline_3deg(initCoords3d, props, outType, closed = initCoords3d['closed'])
        #knotPts = splineObject['knotPts']
        #bezierPts = splineObject['bezierPts']
        if outType == "coordinates":
            propString = []
            for k in props:
                propString.append(str(k)+'=\"'+str(props[k])+'\"')
            pString = " ".join(propString)
            splineObject = "".join(splineObject)
            pline = '<path d="'+splineObject+'" '+pString+'/>'
            return pline
        return splineObject
    except Exception as e:
        LOG.append("spline: "+str(errorLog(e)))
        return ""
def polycurve(o, props, collection = False):
    #print(o)
    try:
        parts = []
        for part in o:
            part = part["geometry"]["coordinates"]
            polycurvePath = []
            for curve_i, curve in enumerate(part):
                #for curveInfo in curve['geometry']["coordinates"]:
                #print(curve)
                svgCurve = spline(curve["geometry"]["coordinates"],{},outType="coordinates")
                polycurvePath.append(svgCurve)
        polycurvePath = ' '.join(polycurvePath)
        return polycurvePath
    except Exception as e:
        LOG.append("polycurve"+str(errorLog(e)))
        return ""

    
def circPath(cx,cy,r, cclockwise):
    #NOTE : Assumes direction pattern is T/F
    #"M" + cx + "," + cy + "m" + (r) + ",0" + "a" + r + "," + r + " 0 1,1 " + (-r * 2) + ",0" + "a" + r + "," + r + " 0 1,1 " + (r * 2) + ",0"
    circPath = "M %.2f, %.2f m %.2f, 0 a %.2f, %.2f 0 1,%s %.2f, 0 a %.2f, %.2f 0 1, %s %.2f, 0"%(cx, cy, r, r, r, cclockwise, -r*2, r, r, cclockwise, r*2)
    return circPath


def circle(o, props, collection = False):
    #<circle cx="50" cy="50" r="50"/>
    circList = []
    for index, coords in enumerate(o):
        coords = coords['geometry']
        print (coords['coordinates'])
        pt = point(coords['coordinates'], 'line')
        propString = []
        for k in props:
            #print(k)
            #print(props[k])
            propString.append(str(k)+'=\"'+str(props[k])+'\"')
        pString = " ".join(propString)
        
        #pline = NurbsCurve.ByControlPoints(polarray,1,o['properties']['closed'])
        if collection:
            cclockwise = index%2
            #print (cclockwise)
            circ = circPath(pt[0],pt[1],coords['radius']/layout['scale'], cclockwise)
            #print (circ)
            #circ = ''.join([str(item) for item in circ])
        else:
            circ = '<circle cx="%.2f" cy="%.2f" r="%.2f" %s/>'%(pt[0],pt[1],coords['radius']/layout['scale'],pString)
        circList.append(circ)
    print (circList)
    
    circList = " ".join(circList)
    if collection:
        circList = '<path d= "%s" %s/>'%(circList, pString)
    return circList

def text(o, props):
    try:
        print("text")
        #<text class="CLASS" zindex="500" transform="matrix(1 0 0 1 210 148.5)">TEXT</text> 
        propString = []
        for k in props:
            propString.append(str(k)+'=\"'+str(props[k])+'\"')
        pString = " ".join(propString)
        
        if type(o) == type([]):
            o = o[0]["geometry"]
        print(o)
        gm = o['coordinates']
        planeorigin = [gm[3],gm[7],gm[11]]
        print(planeorigin)
        planeremap = point(planeorigin,"rplane")
        matrix = [str(gm[0]), str(gm[1]),str(gm[4]),str(gm[5]), str(planeremap[0]), str(planeremap[1])]
        matrixtext = " ".join(matrix)
        text = '<text '+pString+' transform="matrix(%s)">%s</text>'%(matrixtext,o['content'])
        print(text)
        return text
    except Exception as e:
        print(errorLog(e))
        return None
def image(o, props):
    try:
        #<image width="132.543857" height="132.543857" transform="matrix(-0.173648 -0.984808 0.984808 -0.173648 28.869475 131.454367)" xlink:href="K:\Computational Design Group\20.png"'"/>
        propString = []
        for k in props:
            propString.append(str(k)+'=\"'+str(props[k])+'\"')
        pString = " ".join(propString)
        if type(o) == type([]):
            o = o[0]["geometry"]
        gm = o['coordinates']
        yvec = [gm[1]*o['height'],gm[5]*o['height'],gm[9]*o['height']]
        planeorigin = [gm[3]+yvec[0],gm[7]+yvec[1],gm[11]+yvec[2]]
        planeremap = point(planeorigin,"rplane")
        imgPlane = r.Geometry.Plane(r.Geometry.Point3d(gm[3],gm[7],gm[11]),r.Geometry.Vector3d(gm[0],gm[4],gm[8]),r.Geometry.Vector3d(gm[1],gm[5],gm[9]))
        worldPlane = r.Geometry.Plane(r.Geometry.Point3d(0,0,0),r.Geometry.Vector3d(1,0,0),r.Geometry.Vector3d(0,1,0))
        transform = r.Geometry.Transform.PlaneToPlane(lPlane,worldPlane)
        imgPlane.Transform(transform)
        npln = [imgPlane.XAxis.X,imgPlane.YAxis.X,imgPlane.ZAxis.X,imgPlane.OriginX,imgPlane.XAxis.Y,imgPlane.YAxis.Y,imgPlane.ZAxis.Y,imgPlane.OriginY,imgPlane.XAxis.Z,imgPlane.YAxis.Z,imgPlane.ZAxis.Z,imgPlane.OriginZ,0,0,0,1]
        matrix = [str(npln[0]), str(npln[1]),str(npln[4]),str(npln[5]), str(planeremap[0]), str(planeremap[1])]
        matrixtext = " ".join(matrix)
        text = '<image transform="matrix(%s)" width="%s" height="%s" xlink:href="%s"/>'%(matrixtext,o['width']/layout['scale'],o['height']/layout['scale'],o['image'])
        print(text)
        return text
    except Exception as e:
        print(errorLog(e))
        return None
function_mappings = {
        'FeatureCollection':featurecollection,
        'Feature': feature,
        'Circle':circle,
        'Arc':arc,
        'Polyline': polyline,
        'Spline': spline,
        'PolyCurve': polycurve,
        'CurveCollection': curvecollection,
        'Line': line,
        'Text': text,
        'Image':image,
}
obarray = []
if not LAYOUT:
    layout = {"plane": [[0.0, 0.0, 0.0], [1.0, 0.0, 0.0], [0.0, 1.0, 0.0]], "page": [420, 297], "scale": 1.0}
else:
    layout = json.loads(LAYOUT)
lPlane = layout['plane']
lOrigin = r.Geometry.Point3d(lPlane[0][0],lPlane[0][1],lPlane[0][2])
lXAx = r.Geometry.Vector3d(lPlane[1][0],lPlane[1][1],lPlane[1][2])
lYAx = r.Geometry.Vector3d(lPlane[2][0],lPlane[2][1],lPlane[2][2])
lPlane = r.Geometry.Plane(lOrigin,lXAx,lYAx)
try:
    for i in ARCHIJSON:
        if i["type"]:
            #print(i)
            print(i['type'])
            fCall = function_mappings[i['type']]
            fCall(i)
        else:
            fCall = function_mappings[i['geometry']['type']]
            obarray.append(fCall(i['geometry']))

    #OUT = log
    template =Template("""<?xml version="1.0" encoding="utf-8"?>
    <!-- Generator: Grasshopper 1.0.0, Redback Plugin. SVG Version: 6.00 Build 0) Made by Andrew Butler at Cox Architecture -->
    <!DOCTYPE svg PUBLIC "-//W3C//DTD SVG 1.1//EN" "http://www.w3.org/Graphics/SVG/1.1/DTD/svg11.dtd">
    <svg version="1.1" xmlns="http://www.w3.org/2000/svg" xmlns:xlink="http://www.w3.org/1999/xlink" x="0px" y="0px"
    width="${width}mm" height="${height}mm" viewBox="0 0 ${width} ${height}" xml:space="preserve">
    <style type="text/css">
    $css
    </style>
    $svg
    </svg>""")
    #print(layout)
    if not CSS:
        CSS = [None]
    if len(CSS) == 1:
        if CSS[0] == None:
            CSS = [""]
    svgdict = {'svg':"\n".join(obarray),'width':layout['page'][0],'height':layout['page'][1],'css':"\n".join(CSS)}
    svgfull = template.substitute(svgdict)
    SVG = svgfull.split("\n")
    #L = log


except Exception as e:
    print("?",errorLog(e))
    LOG.append("based error: "+str(errorLog(e)))
    SVG = None
    pass
# ---------- end svg ----------
panel_7 = Panel("""1
2
3""")
panel_8 = Panel(json_keys)
shift = ShiftPaths(Data=read_json, Offset=-1)
graft = GraftTree(Tree=flatten(partition_2), IncludeEmptyLists=True, IncludeNullItems=True)  # -> simplify(Tree)
graft_2 = GraftTree(Tree=flatten(long.ListB), IncludeEmptyLists=True, IncludeNullItems=True)  # -> simplify(Tree)
panel_9 = Panel("""testing\test.icml
testing\test2.icml""")
panel_10 = Panel("""value
class""")
wrapper = IronPython2Script(CO=panel_7, WR="\"", DE=",")  # -> RE; inputs CO: list
# ---------- wrapper: IronPython ----------
#### Constants ####
global __var__
__var__ = {
	"guid":"8e12d3d2-9c02-4af4-8931-ae8a51372bd0",
	
	"name":"Text Wrapper",
	"nickname":"Wrapper",
	"description":"Wraps and joins text with selected data characters",
	"icon": "ghContent\\Icon-Wrapper.png",

	"tabname":"Redback",
	"section":"JSON",

	"inputs":[
		{"name":"Content",			"nickname":"C",	"objectAccess":"list",	"description":"Text content to wrap", },
		{"name":"Wrap Character",	"nickname":"W",	"objectAccess":"item",	"description":"Character that will wrap the text", },
		{"name":"Join Character",	"nickname":"J",	"objectAccess":"item",	"description":"Character that will join the text, leave empty to wrap each individually", },
	],
	"outputs":[
		{"name":"Wrapped Text",	"nickname":"W",	"description":"Wrapped Text"}
	]
}
__author__ = "Andrew.Butler"
__version__ = "2024.02.02"
	
lut = {
	'': {'t':'[{value}]'},
	'"': {'t':'"{value}"'},
	"'": {'t':"'{value}'"},
	'{': {'t':'{{{value}}}'},
	'}': {'t':'{{{value}}}'},
	'{}': {'t':'{{{value}}}'},
	'[': {'t':'[{value}]'},
	']': {'t':'[{value}]'},
	'[]': {'t':'[{value}]'},
	'(': {'t':'({value})'},
	')': {'t':'({value})'},
	'()': {'t':'({value})'},
}

C = CO
W = WR
J = DE


def wrapText(text, wrap):
	if wrap in lut:
		template = lut[wrap]["t"]
		print(template)
		return template.format(value=text)
	else:
		return wrap+text+wrap

if not C:
	C = []
if not W:
	W = ""


if J != None:
	C = [J.join(C)]

outText = list(map(lambda x: wrapText(x, W), C))


RE = outText
# ---------- end wrapper ----------
merge_2 = Merge(Data1=simplify(graft), Data2=simplify(graft_2))
panel_11 = Panel(wrapper)
relative_path = IronPython2Script(PA=Toggle(False), RP=panel_9)  # -> FP, DI, FN
#   port PA: Accepts path string or Boolean for current Rhino or Grasshopper document path
# ---------- relative_path: IronPython ----------
#### Constants ####
global __var__
__var__ = {
    "guid":"41bdcdeb-7482-4608-873f-59490830db42",
    
    "name":"Relative Path",
    "nickname":"Rel Path",
    "description":"Creates a relative path to Rhino/GH document",
    "icon": "ghContent\\Icon-RelativePath.png",

    "tabname":"Redback",
    "section":"Files",

    "inputs":[
        {"name":"Path",		"nickname":"P",	"objectAccess":"item",	"description":"Path to append, or Boolean to choose current (F)Grasshopper or (T)Rhino document.", },
        {"name":"Relative Path",			"nickname":"R",	"objectAccess":"item",	"description":"Relative Path string", },
    ],
    "outputs":[
        {"name":"Full path",		"nickname":"F",	"description":"Full Path"},
        {"name":"Directory path",	"nickname":"D",	"description":"Directory Path"},
        {"name":"File name",		"nickname":"N",	"description":"File name"},
    ]
}
        
import os
import Rhino
import scriptcontext as sc
P = PA
R = RP
try:
    if P == None:
        P = False
    #if not R:
        #R = ""
    if type(P) == type(False): 
        if P:
            DOC = Rhino.RhinoDoc.ActiveDoc.Path
        else:
            DOC = sc.doc.Path
    else:
        DOC = P
    #print(DOC)
    if os.path.isdir(DOC):
        docDir = DOC
        docName = None
    else:
        docDir, docName = os.path.split(DOC)
    
    docDirs = docDir.split(os.sep)
    #print("1 docDirs",docDirs)
    if R == None:
        R = docName
    try:
        relDirs = R.split(os.sep)
    except:
        relDirs = []



    for pathStep in relDirs:
        #print("pathstep", pathStep)
        if pathStep == ".":
            del docDirs[-1]

    relDirs = list(filter(lambda x: x != ".", relDirs))
    #print("relDirs",relDirs)
    #print("docDirs",docDirs)
    newDirs = docDirs+relDirs
    #print("newDirs",newDirs)
    newDirs = list(map(lambda x: x.replace(":", ":"+os.sep), newDirs))
    newDir = os.path.join(*newDirs)

    #print(newDir)
    FP = newDir
    if os.path.isdir(newDir):
        DI = newDir
        FN = None
    else:
        DI, FN = os.path.split(newDir)
except Exception as e:
    print(e)
    FP = R
    DI, FN = os.path.split(R)
# ---------- end relative_path ----------
json = CreateJSON(K=panel_10, V=merge_2)
unflatten = UnflattenTree(Tree=json, Guide=partition_2)  # -> simplify(Tree)
panel_12 = Panel(unflatten)
graft_3 = GraftTree(Tree=relative_path.DI, IncludeEmptyLists=True, IncludeNullItems=True)
graft_4 = GraftTree(Tree=relative_path.FN, IncludeEmptyLists=True, IncludeNullItems=True)
int = Integer(1)
tree2list = IronPython2Script(T=unflatten, B=int)  # -> L; inputs T: tree, B: Int32
# ---------- tree2list: IronPython ----------
List = None
__author__ = "danielle.bisazza"
__version__ = "2022.06.30"
import Grasshopper as gh
import sys
import json
import ghpythonlib.treehelpers as th
                
                
def TreeToPythonList(input, retrieve_base = lambda x: x[0]):
    """Returns a list representation of a Grasshopper DataTree"""
    def extend_at(path, index, simple_input, rest_list):
        #print("INPUT -- ", simple_input)
        #print("REST LIST ---", rest_list)
        target = path[index]
        #print("TARGET --", target)
        #print("INDEX  --", index)
        #try:
            #simple_input = [int("%.2f") %num for num in list(simple_input)] #round ints to 2dec
        #except:
            #simple_input = list(simple_input)
        sortList = []
        for value in list(simple_input):
            #print("VALUE:  ", value, "TPYE:  ", type(value))
            if type(value) == type(""):
                try: 
                    value = json.loads(str(value))
                except:
                    pass
                sortList.append(value)
                #print(value)
            #### TO BE FIXED? - FLOATS ####
            elif type(value) == type(0.0):
                try:
                    value = "{:.2f}".format(value)
                    #print ("FLOAT", value)
                except:
                    pass
                sortList.append(value)
            else:
                sortList.append(value)
                                
        #print(sortList)
        if len(rest_list) <= target: #make empty space for new value
            #print("-MAKING NEW SPOT-", rest_list)
            rest_list.extend([None]*(target-len(rest_list)+1))
        elif not (isinstance(i, list) for i in rest_list):
            #print("EXTENDED LIST -- ", rest_list)
            pass
        if index == path.Length - 1:
            try:
                if rest_list[target] != None: #if trying to replace value
                    #print(">><<<")
                    rest_list.insert(target, sortList)
                else:
                    #print("replace", rest_list[target], sortList)
                    rest_list[target] = sortList
                    #print("new -- ", rest_list)
            except:
                rest_list[target] = sortList
        else:
            if rest_list[target] is None: 
                rest_list[target] = []
            #print ("---- LOOOPPP ----", type(rest_list))
            extend_at(path, index+1, sortList, rest_list[target])

    all = []
    #print(input)
    for i in range(input.BranchCount):

        path = input.Path(i)
        
        #print(list(path.Indices))
        #print(dir(path))

        extend_at(path, 0, input.Branch(path), all)
    
    #sublists = [my_list[i:i+j] for i,j in zip(range(0,len(my_list)), [2,3,4,1])] 
    #print(all)
    return all
                    
#print(T, type(T))
Tree = TreeToPythonList(T)
#print(Tree)

outData = []


def splitListRecursive(datalist,targetLevel=0, _currentLevel=0):
    if _currentLevel == targetLevel:
        outData.append(json.dumps(datalist, ensure_ascii=False))
    else:
        for i in datalist:
            splitListRecursive(i, targetLevel, _currentLevel+1)

splitListRecursive(Tree,B)


L = th.list_to_tree(outData, source=[0,0])
# ---------- end tree2list ----------
panel_13 = Panel("{\"columnWidths\": [10,20],\"columnWidthsRev\": [10], \"variables\": {\"line-thick\": 2, \"line-medium\": 1, \"line-thin\": 0.5 }}")
panel_14 = Panel("""*{paragraphStyle:Table - Small;}
.A{characterStyle:Bold;}
bord{weight:1;}
[xPos=1]{weight:2;}""")
graft_5 = GraftTree(Tree=tree2list, IncludeEmptyLists=True, IncludeNullItems=True)
icml = IronPython2Script(DA=graft_5, OP=panel_13, CS=panel_14)  # -> TA; inputs OP: list, CS: list
# ---------- icml: IronPython ----------
global __var__
__var__ = {
	"guid":"89da792a-24b2-41fa-a674-20d9df2b5b6f",
	
	"name":"ICML Generator",
	"nickname":"ICML",
	"description":"Takes JSON data formated as a lists of lists and creates a InCopy Markup Language format of a table.",
	"icon": "ghContent\\Icon-TableMaker.png",

	"tabname":"Redback",
	"section":"Tables",

	"inputs":[
		{"name":"Data",		"nickname":"D",	"objectAccess":"item",	"description":"Table data formated as a JSON list of lists", },
		{"name":"Options",	"nickname":"O",	"objectAccess":"list",	"description":"Table options as a JSON dictionary"},
		{"name":"CSS",		"nickname":"C",	"objectAccess":"list",	"description":"CSS to apply styles to the table"}
	],
	"outputs":[
		{"name":"Table",	"nickname":"T",	"description":"ICML Table"}
	]
}
__author__ = "Andrew.Butler"
__version__ = "2024.02.02"

import sys
import os
user = os.environ['USERPROFILE']
import json
try:    sys.path.append(r"\\sydsrv01\projects\Computational Design Group\93_Development\PackageManager\redback\py".format(**{'user':user}))
except: pass
try:    sys.path.append(r"E:\mydev\redback\py".format(**{'user':user}))
except: pass
import pyTableMaker as tm
from pyCSSParser import parseCSS


D = DA
O = OP
C = CS

__log__ = []


__log__.append(str(C))




D = json.loads(D)
if not O:
	O = {"css":[]}
else:
	O = json.loads("".join(O))

if C:
	C = "".join(C)
	C = parseCSS(C)
	O["css"] = C
print("OPTIONS",O)


TA = tm.table(D, O)
# ---------- end icml ----------
write_file = IronPython2Script(R=Toggle(True), CO=icml, FD=graft_3, FN=graft_4)  # -> FP; inputs R: Boolean, CO: list of String, FD: String, FN: String
# ---------- write_file: IronPython ----------
#### Constants ####
global __var__
__var__ = {
	"guid":"9bf0fbf6-1cb9-49e0-b0a0-0ced95dcf5f9",
	
	"name":"Write File",
	"nickname":"Write",
	"description":"Saves data to file",
	"icon": "ghContent\\Icon-WriteFile.png",

	"tabname":"Redback",
	"section":"Files",

	"inputs":[
		{"name":"Run",			"nickname":"R",	"objectAccess":"item",	"description":"", },
		{"name":"Content",		"nickname":"C",	"objectAccess":"list",	"description":"", },
		{"name":"Folder",		"nickname":"P",	"objectAccess":"item",	"description":"", },
		{"name":"Name",			"nickname":"N",	"objectAccess":"item",	"description":"", },
	],
	"outputs":[
		{"name":"Filepath",	"nickname":"F",	"description":"Absolute path to saved file"}
	]
}
__author__ = "Andrew.Butler"
__version__ = "2024.02.02"
#### Constants ####

C = CO
P = FD
N = FN        
import os
from json import dumps
def check(o):
    if str(type(o)) == "<type 'dict'>":
        return dumps(o)
    else:
        return o
FP = None
if R:
    con = list(map(lambda u: check(u), C))
    conwrite = "\n".join(con)
    directory = P+"\\"+N
    fileDir, _t = os.path.split(directory)
    if not os.path.isdir(fileDir):
        os.makedirs(fileDir)
    FP = directory
    with open(directory,'wb') as f:
        f.write(conwrite.encode("UTF-8"))
# ---------- end write_file ----------
panel_15 = Panel(write_file)
